# Dynamo graph Miscellany-Samples-GeometryDisplay.dyn (Dynamo 2.0.1.5055)

code_block = CodeBlock { [-1000,0,4000,5000,8000]; [1000,2000,1000,0,1000]; [6000,3000,5000,3000,5000]; }
byCoordinates = Point.ByCoordinates(x=code_block.out0, y=code_block.out1, z=code_block.out2)
byPoints = NurbsCurve.ByPoints(points=byCoordinates)
code_block_2 = CodeBlock { 0.25; 0.5; 0.75; }
normalAtParameter = Curve.NormalAtParameter(curve=byPoints, param=code_block_2.out1)
pointAtParameter = Curve.PointAtParameter(curve=byPoints, param=code_block_2.out2)
display_scale = IntegerSlider(2671, range=0..4000 step 1)
planeAtParameter = Curve.PlaneAtParameter(curve=byPoints, param=code_block_2.out1)
coordinateSystemAtParameter = Curve.CoordinateSystemAtParameter(curve=byPoints, param=code_block_2.out0)

# group: Miscellany
display = Miscellany.Geometry.Abstract.Vector.Display(vector=normalAtParameter, startPoint=pointAtParameter, scale=display_scale)
display_2 = Miscellany.Geometry.Abstract.Plane.Display(plane=planeAtParameter, length=display_scale)
display_3 = Miscellany.Geometry.Abstract.CoordinateSystem.Display(coordinateSystem=coordinateSystemAtParameter, length=display_scale)
