# Dynamo graph Miscellany-Samples-List.dyn (Dynamo 2.0.1.5055)

code_block = CodeBlock { ["a","b","c","d","e"]; }
code_block_2 = CodeBlock { [0,"b",["h","i"],Point.ByCoordinates(1000,2000,3000),"e"]; }

# group: Miscellany
pairItems = Miscellany.List.PairItems(list=code_block)
pairItems_2 = Miscellany.List.PairItems(list=code_block_2)

watch = Watch(pairItems)
watch_2 = Watch(pairItems_2)
