# Dynamo graph Miscellany-Samples-PackContainer.dyn (Dynamo 2.0.1.5055)

code_block = CodeBlock { 1; 200; 800; 300; }
code_block_2 = CodeBlock()
# ---------- code_block_2.designscript (5 lines) ----------
[1,2,3,4,5,6,7,8,9,10];
[100,200,100,300,150,200,100,200,250,300];
[200,200,150,200,200,100,150,150,200,200];
[20,25,30,35,50,10,20,20,30,20];
[2,50,2,20,2,2,2,2,2,200];
# ----------------------------------------

# group: Miscellany
container = Miscellany.ContainerPacking.Entities.Container.Container(id=code_block.out0, length=code_block.out1, width=code_block.out3, height=code_block.out2)
item = Miscellany.ContainerPacking.Entities.Item.Item(id=code_block_2.out0, dim1=code_block_2.out1, dim2=code_block_2.out2, dim3=code_block_2.out3, quantity=code_block_2.out4)

# group: Miscellany
packContainer = Miscellany.ContainerPacking.PackingService.PackContainer(container=container, itemsToPack=item)

code_block_3 = CodeBlock(container=container) { container; }

# group: Miscellany
coordX = Miscellany.ContainerPacking.Entities.Item.CoordX(item=packContainer.packedItems)
coordY = Miscellany.ContainerPacking.Entities.Item.CoordY(item=packContainer.packedItems)
coordZ = Miscellany.ContainerPacking.Entities.Item.CoordZ(item=packContainer.packedItems)
packDimX = Miscellany.ContainerPacking.Entities.Item.PackDimX(item=packContainer.packedItems)
packDimY = Miscellany.ContainerPacking.Entities.Item.PackDimY(item=packContainer.packedItems)
packDimZ = Miscellany.ContainerPacking.Entities.Item.PackDimZ(item=packContainer.packedItems)
length = Miscellany.ContainerPacking.Entities.Container.Length(container=code_block_3)
width = Miscellany.ContainerPacking.Entities.Container.Width(container=code_block_3)
height = Miscellany.ContainerPacking.Entities.Container.Height(container=code_block_3)

byCoordinates = Point.ByCoordinates(x=coordX, y=coordY, z=coordZ)
byCoordinates_2 = Vector.ByCoordinates(x=packDimX, y=packDimY, z=packDimZ)
add = Point.Add(point=byCoordinates, vectorToAdd=byCoordinates_2)
byCorners = Cuboid.ByCorners(lowPoint=byCoordinates, highPoint=add)
byCoordinates_3 = Point.ByCoordinates(x=length, y=width, z=height)
byCorners_2 = Cuboid.ByCorners(highPoint=byCoordinates_3)
edges = Topology.Edges(topology=byCorners_2)
curveGeometry = Edge.CurveGeometry(edge=edges)
byCoordinates_4 = Point.ByCoordinates(x=code_block.out1, y=code_block.out2, z=code_block.out3)
byCorners_3 = Cuboid.ByCorners(highPoint=byCoordinates_4)
edges_2 = Topology.Edges(topology=byCorners_3)
curveGeometry_2 = Edge.CurveGeometry(edge=edges_2)
